# Grasshopper definition call_from_hops.gh (Grasshopper 1.0.7)
# plug-ins: Hops

number_slider = Slider(36, range=20..40)
pt = Point(Point(-25, 0, 0))
cir = Circle(Plane=pt, Radius=Slider(18, range=10..20))
point_at_opposite = Hops(
    Curve=cir,
    T=number_slider,
    CacheResultsInMemory=False,
    CacheSolveResults=False,
    RemoteDefinitionLocation="http://127.0.0.1:5000/pointatopposite",
    RemoteSolveVersion=(0, 1, 0),
    ShowInput_Enabled=False,
    ShowInput_Path=False,
    SynchronousSolve=True)
crvdom = CurveDomain(Curve=cir)  # -> Curve, Domain
hops = Hops(
    Curve=cir,
    T=number_slider,
    CacheResultsInMemory=False,
    CacheSolveResults=False,
    RemoteDefinitionLocation="http://127.0.0.1:5000/pointat",
    RemoteSolveVersion=(0, 1, 0),
    ShowInput_Enabled=False,
    ShowInput_Path=False,
    SynchronousSolve=True)
pt_2 = Point(point_at_opposite)
pt_3 = Point(hops)
